# Grasshopper definition 1.01.gh (Grasshopper 1.0.8)

# ----
# ELLIPSE
number_slider = Slider(16, range=0..30)
c_script = CSharpScript(radius1=number_slider, radius2=Slider(16, range=0..30), count=Slider(31, range=0..100))  # -> out, a; inputs radius1: Double, radius2: Double, count: Int32
# ---------- c_script: C# ----------
// Grasshopper Script Instance
#region Usings
using System;
using System.Linq;
using System.Collections;
using System.Collections.Generic;
using System.Drawing;

using Rhino;
using Rhino.Geometry;

using Grasshopper;
using Grasshopper.Kernel;
using Grasshopper.Kernel.Data;
using Grasshopper.Kernel.Types;
#endregion

public class Script_Instance : GH_ScriptInstance
{
    #region Notes
    /* 
      Members:
        RhinoDoc RhinoDocument
        GH_Document GrasshopperDocument
        IGH_Component Component
        int Iteration

      Methods (Virtual & overridable):
        Print(string text)
        Print(string format, params object[] args)
        Reflect(object obj)
        Reflect(object obj, string method_name)
    */
    #endregion

    private void RunScript(double radius1, double radius2, int count, ref object a)
    {
        // Write your logic here

        double step = (2 * Math.PI) / count;
        List<Point2d> points = new List<Point2d>();

        for(double i = 0; i<2 * Math.PI; i += step)
        {
            double x = (Math.Cos(i) * radius1);
            double y = (Math.Sin(i) * radius2);

            Point2d point  = new Point2d(x,y);
            points.Add(point);
        } 
        a = points;
    }
}
# ---------- end c_script ----------
pt = Point(c_script.a)
nurbs = NurbsCurve(Vertices=pt, Degree=Slider(3, range=0..3), Periodic=Toggle(True))  # -> Curve, Length, Domain
crv = Curve(nurbs.Curve)

# ----
# ELLIPSE CROSSED WITH A DIAMOND
number_slider_2 = Slider(15, range=0..30)
c_script_2 = CSharpScript(radius1=number_slider_2, radius2=Slider(9, range=0..30), count=Slider(31, range=0..100))  # -> out, a; inputs radius1: Double, radius2: Double, count: Int32
# ---------- c_script_2: C# ----------
// Grasshopper Script Instance
#region Usings
using System;
using System.Linq;
using System.Collections;
using System.Collections.Generic;
using System.Drawing;

using Rhino;
using Rhino.Geometry;

using Grasshopper;
using Grasshopper.Kernel;
using Grasshopper.Kernel.Data;
using Grasshopper.Kernel.Types;
#endregion

public class Script_Instance : GH_ScriptInstance
{
    #region Notes
    /* 
      Members:
        RhinoDoc RhinoDocument
        GH_Document GrasshopperDocument
        IGH_Component Component
        int Iteration

      Methods (Virtual & overridable):
        Print(string text)
        Print(string format, params object[] args)
        Reflect(object obj)
        Reflect(object obj, string method_name)
    */
    #endregion

    private void RunScript(double radius1, double radius2, int count, ref object a)
    {
        // Write your logic here

        double step = (2 * Math.PI) / count;
        List<Point2d> points = new List<Point2d>();

        for(double i = 0; i<2 * Math.PI; i += step)
        {
            double x = Math.Cos(i) * radius1;
            double y = Math.Abs(Math.Sin(i)) * 0.5 * Math.Sin(i) * radius2;

            Point2d point  = new Point2d(x,y);
            points.Add(point);
        } 
        a = points;
    }
}
# ---------- end c_script_2 ----------
pt_2 = Point(c_script_2.a)
nurbs_2 = NurbsCurve(Vertices=pt_2, Degree=Slider(3, range=0..3), Periodic=Toggle(True))  # -> Curve, Length, Domain
crv_2 = Curve(nurbs_2.Curve)

# ----
# ELLIPSE CROSSED WITH A HYPOCYCLOID
number_slider_3 = Slider(16, range=0..30)
c_script_3 = CSharpScript(radius1=number_slider_3, radius2=Slider(2, range=0..30), count=Slider(31, range=0..100))  # -> out, a; inputs radius1: Double, radius2: Double, count: Int32
# ---------- c_script_3: C# ----------
// Grasshopper Script Instance
#region Usings
using System;
using System.Linq;
using System.Collections;
using System.Collections.Generic;
using System.Drawing;

using Rhino;
using Rhino.Geometry;

using Grasshopper;
using Grasshopper.Kernel;
using Grasshopper.Kernel.Data;
using Grasshopper.Kernel.Types;
#endregion

public class Script_Instance : GH_ScriptInstance
{
    #region Notes
    /* 
      Members:
        RhinoDoc RhinoDocument
        GH_Document GrasshopperDocument
        IGH_Component Component
        int Iteration

      Methods (Virtual & overridable):
        Print(string text)
        Print(string format, params object[] args)
        Reflect(object obj)
        Reflect(object obj, string method_name)
    */
    #endregion

    private void RunScript(double radius1, double radius2, int count, ref object a)
    {
        // Write your logic here

        double step = (2 * Math.PI) / count;
        List<Point2d> points = new List<Point2d>();

        for(double i = 0; i<2 * Math.PI; i += step)
        {
            int num_cusps = 5;
            double x = Math.Cos(i) * radius1;
            double y = (((num_cusps-1)*Math.Sin(i)) + Math.Sin((num_cusps-1)*i)) * radius2;

            Point2d point  = new Point2d(x,y);
            points.Add(point);
        } 
        a = points;
    }
}
# ---------- end c_script_3 ----------
pt_3 = Point(c_script_3.a)
nurbs_3 = NurbsCurve(Vertices=pt_3, Degree=Slider(3, range=0..3), Periodic=Toggle(True))  # -> Curve, Length, Domain
crv_3 = Curve(nurbs_3.Curve)
